# Grasshopper definition Tree_Model.gh (Grasshopper 1.0.8)
# plug-ins: LunchBox

file_path = FilePath("C:\Users\st1174360\Documents\GitHub\CodeBTh04\arbeitspakete\02_segmentierung\01_Segm_Baeume\output\Baumdaten\02_v2_baumdaten_Platte3_3631.csv")
read_file = ReadFile(File=file_path, PerLineParse=True)

# ---- group: Header/Data Splitt
split_list = SplitList(List=read_file, Index="1")  # -> ListA, ListB

# ---- group: Daten trennen
text_split = TextSplit(Text=split_list.ListB, Separators=",")  # -> flatten(Result)

# ----
list_length = ListLength(List=split_list.ListB)
header_mit_spaltennamen = Panel(split_list.ListA)

series = Series(Start="0", Step=1, Count="15")
series_2 = Series(Start=series, Step="15", Count=list_length)
list_item = ListItem(List=text_split, Index=series_2, Wrap=True)

param_viewer = ParamViewer(list_item)

# ---- group: Daten nach Spalten sortiert
explode_tree = ExplodeTree(Data=list_item)  # -> _0000, _0001, _0002, _0003, _0004, _0005, _0006, _0007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

# ----
construct_point = ConstructPoint(XCoordinate=explode_tree._0001, YCoordinate=explode_tree._0002, ZCoordinate=explode_tree._0003)
unit_z = UnitZ(Factor=explode_tree._0004)
unit_z_2 = UnitZ(Factor=explode_tree._0007)
move = Move(Geometry=construct_point, Motion=unit_z_2)  # -> Geometry, Transform
move_2 = Move(Geometry=construct_point, Motion=unit_z)  # -> Geometry, Transform
division = Division(A=explode_tree._0005, B=2)
division_2 = Division(A=explode_tree._0006, B=2)
division_3 = Division(A=explode_tree._0008, B=2)

max_punkt_krone = Point(move_2.Geometry)
min_punkt_krone = Point(move.Geometry)
min_punkt_stamm = Point(construct_point)

# ----
# Krone als Ellipse
# mit Halbachsen Kronen Höhe/Durchmesser
line = Line(StartPoint=max_punkt_krone, EndPoint=min_punkt_krone)
curve_middle = CurveMiddle(Curve=line)
yz_plane = YZPlane(Origin=curve_middle)
ellipse = Ellipse(Plane=yz_plane, Radius1=division_2, Radius2=division)  # -> Ellipse, Focus1, Focus2
revolution = Revolution(Curve=ellipse.Ellipse, Axis=line, Domain=Domain(0, 6.283185307))
crown = ColourRGB(Alpha=255, Red=explode_tree._0009, Green=explode_tree._00010, Blue=explode_tree._00011)
custom_preview = CustomPreview(
    Geometry=revolution,
    Material={diffuse=RGB(221, 160, 221), emission=RGB(66, 48, 66), shine=0.5, specular=RGB(255, 255, 255), transparency=0})

# ----
# Stamm als Zylinder
line_2 = Line(StartPoint=min_punkt_krone, EndPoint=min_punkt_stamm)
extend_curve = ExtendCurve(Curve=line_2, Type=0, Start="0.1", End="0.0")
trunk = ColourRGB(Alpha=255, Red=explode_tree._00012, Green=explode_tree._00013, Blue=explode_tree._00014)
pipe = Pipe(Curve=extend_curve, Radius=division_3, Caps=1)
list_item_2 = ListItem(List=trunk, Index=0, Wrap=True)
custom_preview_2 = CustomPreview(
    Geometry=pipe,
    Material={diffuse=RGB(221, 160, 221), emission=RGB(66, 48, 66), shine=0.5, specular=RGB(255, 255, 255), transparency=0})

list_item_3 = ListItem(List=crown, Index=0, Wrap=True)
colour_picker = ColourPicker(PickedColour=RGB(55, 122, 55))
colour_picker_2 = ColourPicker(PickedColour=RGB(106, 89, 55))
boolean_toggle = BooleanToggle(False)
object_bake = ObjectBake(
    BakeToggle=boolean_toggle,
    GeometryObjects=revolution,
    Layer="Trees",
    ObjectName="Crown",
    ObjectColor=colour_picker,
    LayerColor=RGB(255, 255, 255))
object_bake_2 = ObjectBake(
    BakeToggle=boolean_toggle,
    GeometryObjects=pipe,
    Layer="Trees",
    ObjectName="Trunk",
    ObjectColor=colour_picker_2,
    LayerColor=RGB(255, 255, 255))
